% Requirement links of HelicopterSoftwareRequirements.slreqx (R2018b)

#10 refines HelicopterSystemRequirements.slreqx#10: SR_6 : Attitude Rate Tracking Performance
#10 refines HelicopterSystemRequirements.slreqx#11: SR_7 : Control Bandwidth
#10 refines HelicopterSystemRequirements.slreqx#12: SR_8 : Control Gain and Phase Margins
#10 refines HelicopterSystemRequirements.slreqx#13: SR_9 : Attitude Rate Authority Limiting
#11 refines HelicopterSystemRequirements.slreqx#10: SR_6 : Attitude Rate Tracking Performance
#11 refines HelicopterSystemRequirements.slreqx#11: SR_7 : Control Bandwidth
#11 refines HelicopterSystemRequirements.slreqx#12: SR_8 : Control Gain and Phase Margins
#11 refines HelicopterSystemRequirements.slreqx#13: SR_9 : Attitude Rate Authority Limiting
#12 refines HelicopterSystemRequirements.slreqx#10: SR_6 : Attitude Rate Tracking Performance
#12 refines HelicopterSystemRequirements.slreqx#11: SR_7 : Control Bandwidth
#12 refines HelicopterSystemRequirements.slreqx#12: SR_8 : Control Gain and Phase Margins
#12 refines HelicopterSystemRequirements.slreqx#13: SR_9 : Attitude Rate Authority Limiting
#13 refines HelicopterSystemRequirements.slreqx#14: SR_10 : Sensor Validation
#14 refines HelicopterSystemRequirements.slreqx#9: SR_5 : Attitude Heading Reference System Interfaces
#15 refines HelicopterSystemRequirements.slreqx#15: SR_11 : Sensor Voting
#16 refines HelicopterSystemRequirements.slreqx#15: SR_11 : Sensor Voting
#17 refines HelicopterSystemRequirements.slreqx#15: SR_11 : Sensor Voting
#5 refines HelicopterSystemRequirements.slreqx#5: SR_1: Pilot Input Signals
#6 refines HelicopterSystemRequirements.slreqx#6: SR_2: Hydraulic Actuator Interfaces
#6 refines HelicopterSystemRequirements.slreqx#7: SR_3: Hydraulic Actuator Signals
#7 refines HelicopterSystemRequirements.slreqx#6: SR_2: Hydraulic Actuator Interfaces
#7 refines HelicopterSystemRequirements.slreqx#7: SR_3: Hydraulic Actuator Signals
#8 refines HelicopterSystemRequirements.slreqx#8: SR_4 : Hydraulic Actuator Control Loop Performance
#9 refines HelicopterSystemRequirements.slreqx#10: SR_6 : Attitude Rate Tracking Performance
#9 refines HelicopterSystemRequirements.slreqx#11: SR_7 : Control Bandwidth
#9 refines HelicopterSystemRequirements.slreqx#12: SR_8 : Control Gain and Phase Margins