test file "AHRS_voter_REQ_Based_Test"
  description: Copyright 2016 The MathWorks, Inc.
  coverage: Decision, MCDC, SignalRange, RelationalBoundary, Condition, LookupTable, SaturationOnIntOverflow

suite "AHRS Voting Test Suite"

  case "Mid Value Voting Test Case" [simulation]
    description: Test the mid value voting algorithm with three valid AHRS.
    model AHRS_voter, harness AHRS_voter_Harness_triple_sensor, mode Software-in-the-Loop (SIL), start time 0, stop time 10

  case "Average Value Voting Test Case" [simulation]
    description: Test the average value voting algorithm with two valid AHRS.
    model AHRS_voter, harness AHRS_voter_Harness_dual_sensor, mode Software-in-the-Loop (SIL), start time 0, stop time 10

  case "Single Value Voting Test Case" [simulation]
    description: Test the single value voting algorithm with one valid AHRS.
    model AHRS_voter, harness AHRS_voter_Harness_single_sensor, mode Software-in-the-Loop (SIL), start time 0, stop time 10