test file "AHRS_voter_SLDV_Based_Test"
  coverage: Decision, MCDC, SignalRange, SimulinkDesignVerifier, RelationalBoundary, Condition, LookupTable, SaturationOnIntOverflow

suite "SLDV-Based Test"

  case "LLR_SLDV" [baseline]
    description: Simulation test for LLR from SLDV.
    model AHRS_voter, harness AHRS_voter_Harness_SLDV
    input "Test Case:1" from AHRS_voter_sldvdata.mat (active)
    input "Test Case:2" from AHRS_voter_sldvdata.mat
    input "Design Verifier (AHRS_voter_sldvdata.mat)" from AHRS_voter_sldvdata.mat
    baseline "TestCases_1.mat": abs tol 1e-06, rel tol 0.001
      voted_fb:1
    baseline "TestCases_2.mat": abs tol 1e-06, rel tol 0.001
      voted_fb:1
    iterations:
      Test Case:1: ExternalInput "Test Case:1", Baseline "TestCases_1.mat"
      Test Case:2: ExternalInput "Test Case:2", Baseline "TestCases_2.mat"