% Simulink data dictionary HeliSystemDD.sldd

AHRS_Bus = Simulink.Bus()
  theta: double, Min=-180, Max=180, Unit="deg"  % Pitch angle
  phi: double, Min=-180, Max=180, Unit="deg"  % Roll angle
  psi: double, Min=0, Max=360, Unit="deg"  % Heading angle
  q: double, Min=-180, Max=180, Unit="deg/sec"  % Pitch rate
  p: double, Min=-180, Max=180, Unit="deg/sec"  % Roll rate
  r: double, Min=-180, Max=180, Unit="deg/sec"  % Yaw rate
  valid: boolean, Min=0, Max=1

Pilot = Simulink.Bus()
  Pedal: double
  CyclicRoll: double
  CyclicPitch: double

ActCmd = Simulink.Bus()
  Command: double, Min=-0.1, Max=0.1, Unit="m"